# Requirement set BungeeRequirementsBase (R2024b)

## 1 [#1] The bungee jumping system shall be operable all year round for the majority of adults.

### 1.1 [#2] The bungee jumping system shall function at a maximum temperature of 50°C.

### 1.2 [#3] The bungee jumping system shall support a maximum weight of 120 kg.

### 1.3 [#4] The bungee jumping system shall support a jumper's maximum surface area of 2 m².

### 1.4 [#5] The bungee jumping system shall have a starting height of 80 m.

### 1.5 [#6] The bungee jumping system shall have an unstretched cord length of 20 m.