test file "BungeeTestsBase"

suite "Bungee Test Suite"

  case "Temperature Test" [baseline]
    model BungeeJumpingDragReqx, stop time 50
    cleanup callback:
      % Test Criterion for Temperature
      if rho ~= 1.093
         error('Failed Temperature Requirement!')
      end

  case "Weight Test" [baseline]
    model BungeeJumpingDragReqx, stop time 10
    cleanup callback:
      % Test Criterion for Weight
      if m ~= 120
         error('Failed Weight Requirement!')
      end

  case "Area Test" [baseline]
    model BungeeJumpingDragReqx, stop time 50
    cleanup callback:
      % Test Criterion for Area
      if A ~= 2
         error('Failed Area Requirement!')
      end

  case "Initial Height Test" [baseline]
    model BungeeJumpingDragReqx, stop time 10
    cleanup callback:
      % Test Criterion for Initial Height
      if x0 ~= 80
         error('Failed Initial Height Requirement!')
      end

  case "Cord Length Test" [baseline]
    model BungeeJumpingDragReqx, stop time 50
    cleanup callback:
      % Test Criterion for Cord Length
      if L ~= 20
         error('Failed Cord Length Requirement!')
      end