test file "BungeeTestsNew"

suite "Bungee Test Suite"

  case "Temperature Test" [baseline]
    model BungeeJumpingDragReqxDerived, stop time 50
    cleanup callback:
      % Test Criterion for Temperature
      if rho ~= 1.093
         error('Failed Temperature Requirement!')
      end

  case "Weight Test" [baseline]
    model BungeeJumpingDragReqxDerived, stop time 50
    cleanup callback:
      % Test Criterion for Weight
      if m ~= 120
         error('Failed Weight Requirement!')
      end

  case "Area Test" [baseline]
    model BungeeJumpingDragReqxDerived, stop time 50
    cleanup callback:
      % Test Criterion for Area
      if A ~= 2
         error('Failed Area Requirement!')
      end

  case "Initial Height Test" [baseline]
    model BungeeJumpingDragReqxDerived, stop time 50
    cleanup callback:
      % Test Criterion for Initial Height
      if x0 ~= 80
         error('Failed Initial Height Requirement!')
      end

  case "Cord Length Test" [baseline]
    model BungeeJumpingDragReqxDerived, stop time 50
    cleanup callback:
      % Test Criterion for Cord Length
      if L ~= 20
         error('Failed Cord Length Requirement!')
      end

  case "Position Test" [baseline]
    model BungeeJumpingDragReqxDerived, stop time 50
    cleanup callback:
      % Test Criterion for Minimum height
      pos = outReq.logsout{1}.Values.Data;
      if min(pos) < 5
         error('Minimum height has not met the requirement!');
      elseif min(pos) >= 5
          disp('Minimum height has been met!');
      end

  case "Spring Constant Test" [baseline]
    model BungeeJumpingDragReqxDerived, stop time 50
    cleanup callback:
      % Test Criterion for Spring Constant
      pos = outReq.logsout{1}.Values.Data;
      if min(pos) < 5 && k <= 40
         error('Spring constant does not support a minimum height above the ground of 5ft!')
      elseif min(pos) >= 5 && k == 50
          disp('Spring constant is commensurate with the height requirement!')
      elseif min(pos) >= 5 && k > 50
          error('Height requirement met, but spring constant is larger than it needs to be!')
      end