# Requirement set FCSHoverRequirements (R2024a)

## 1 [#1] The drone shall be capable of transporting and delivering a 1 kg package.

### 1.1 [#13] The Flight Control System shall define the flight phase for the drone which includes takeoff, landing, cruise, and hover.

#### 1.1.1 [#3] Flight Phase - Takeoff

#### 1.1.2 [#4] Flight Phase - Cruise

#### 1.1.3 [#5] Flight Phase - Landing

#### 1.1.4 [#6] Flight Phase - Hover

##### 1.1.4.1 [#7] During the hover phase, the The Flight Control System software shall prevent the quadcopter from contacting the ground by maintaining an altitude of at least 5 m above ground level.

##### 1.1.4.2 [#8] The Flight Control System software shall define hover flight phase by providing an input velocity of 0 m/s.

##### 1.1.4.3 [#9] The Flight Control System software shall maintain a constant ~0 m/s measured velocity during hover phase.

##### 1.1.4.4 [#10] The Flight Control System software shall incorporate the mass of the drone as 7 kg.

##### 1.1.4.5 [#11] The Flight Control System software shall incorporate the acceleration of gravity as -9.81 m/s^2.

### 1.2 [#2] The Flight Control System shall provide stability information to the airframe for continued maneuverability through the mission.

## 2 [#14] The drone shall achieve a minimum flight range of 30 m per charge.