test file "FCSHoverTests"

suite "Hover Test Suite"

  case "Min Altitude Test" [baseline]
    model FlightControlSoftwareReqx, stop time 50
    cleanup callback:
      % Test Criterion for Minimum Altitude
      alt = outHover.logsout{1}.Values.Data;
      if min(alt) < 5
         error('Minimum altitude has not met the requirement!');
      elseif min(alt) >= 5
          disp('Minimum altitude has been met!');
      end

  case "Input Velocity Test" [baseline]
    model FlightControlSoftwareReqx, stop time 50
    cleanup callback:
      % Test for verifying Desired Velocity
      v0 = str2double(get_param('FlightControlSoftwareReqx/Desired Velocity','Value'));
      if v0 ~= 0
          error('Desired drone velocity is incorrect. Please review FCS requirements.');
      end

  case "Measured Velocity Test" [baseline]
    model FlightControlSoftwareReqx, stop time 50
    cleanup callback:
      % Test Criterion for Measured Velocity
      measV = outHover.logsout{2}.Values.Data;
      tol = 1e-3;
      if measV(end) > tol
         error('Measured velocity has not met the requirement!');
      elseif measV(end) <= tol
          disp('Measured velocity has been met!');
      end

  case "Mass Test" [baseline]
    model FlightControlSoftwareReqx, stop time 50
    cleanup callback:
      % Test for verifying Drone Mass
      m = str2double(get_param('FlightControlSoftwareReqx/Hover Module/Mass of Drone (kg)','Value'));
      if m ~= 7
         error('Mass of drone is incorrect. Please review FCS requirements.');
      end

  case "Gravity Test" [baseline]
    model FlightControlSoftwareReqx, stop time 50
    cleanup callback:
      % Test for verifying Acceleration of Gravity
      g = str2double(get_param('FlightControlSoftwareReqx/Hover Module/Gravity Constant (m//s^2)','Value'));
      if g ~= -9.81
          error('Acceleration of gravity is incorrect. Please review FCS requirements.');
      end